# Grasshopper definition 1_Import_vector.gh (Grasshopper 1.0.7)
# plug-ins: Bifocals, Urbano

# BBOX - tiles
path = FilePath("D:\WORKSHOP\eCAADe-Tirana-DataScapes\eCAADe-Tirana-Data-Scapes-data-downloader\data\bbox_tiles\bbox_tiles.shp")
# Tirana - County
path_2 = FilePath("D:\WORKSHOP\eCAADe-Tirana-DataScapes\data\vector\Tirana-Province\Tirana-Province-4326.shp")
# Vector - Subject
path_3 = FilePath("D:\WORKSHOP\eCAADe-Tirana-DataScapes\data\vector\ECRIN\rivers\ECRIN-rivers-clipped.shp")
importshp = ImportShapefileFeatures(ShapefilePath=path, Reproject=True)  # -> Points, Metadata, UTMZone, TranslationVector

utm = Data(importshp.UTMZone)
vec = Data(importshp.TranslationVector)

avr = Average(Input=importshp.Points)

utm_2 = Data(importshp.UTMZone)
vec_2 = Data(importshp.TranslationVector)

utm_3 = Data(importshp.UTMZone)
vec_3 = Data(importshp.TranslationVector)

importshp_2 = ImportShapefileFeatures(ShapefilePath=path_3, Reproject=True, UTMZone=utm, TranslationVector=vec)  # -> Points, Metadata, UTMZone, TranslationVector
cir = Circle(Plane=avr, Radius=1)
importshp_3 = ImportShapefileFeatures(ShapefilePath=path_2, Reproject=True, UTMZone=utm_3, TranslationVector=vec_3)  # -> Points, Metadata, UTMZone, TranslationVector
alongcrv = SortAlongCurve(Points=importshp.Points, Curve=cir)  # -> Points, Indices
pline = PolyLine(Vertices=alongcrv.Points, Closed=invert(False))
demeta = DeconstructMetadata(Metadata=importshp_2.Metadata)  # -> Keys, Values
nurbs = NurbsCurve(Vertices=importshp_2.Points, Degree=3, Periodic=Toggle(False))  # -> Curve, Length, Domain
nurbs_2 = NurbsCurve(Vertices=importshp_3.Points, Degree=3, Periodic=Toggle(True))  # -> Curve, Length, Domain
mindex = MemberIndex(Set=demeta.Keys, Member="STRAHLER")  # -> Index, Count
panel = Panel(demeta.Keys)
item = ListItem(List=demeta.Values, Index=mindex.Index, Wrap=True)
flatten = FlattenTree(Tree=nurbs.Curve, Path="{0}")
flatten_2 = FlattenTree(Tree=item, Path="{0}")
panel_2 = Panel("""7
6
5
4""")
panel_3 = Panel(item)
mindex_2 = MemberIndex(Set=flatten_2, Member=panel_2)  # -> Index, Count
item_2 = ListItem(List=flatten, Index=mindex_2.Index, Wrap=True)

vector_subject = Data()
tirana_county = Data()
bbox_tile = Data()
entwine = Entwine(Branch00=bbox_tile, Branch01=tirana_county, Branch02=vector_subject, FlattenInputs=True)
