# Grasshopper definition 2_Import_raster.gh (Grasshopper 1.0.7)
# plug-ins: Human, Urbano

# BBOX - tiles
# BBOX - tile
path = FilePath("D:\WORKSHOP\eCAADe-Tirana-DataScapes\eCAADe-Tirana-Data-Scapes-data-downloader\data\bbox_tiles\bbox_tiles.shp")
# Tirana - County
path_2 = FilePath("D:\WORKSHOP\eCAADe-Tirana-DataScapes\data\vector\Tirana-Province\Tirana-Province-4326.shp")
# Right click
# Select Directory
# --> where you downaloaded the raster
raster_directory = FilePath("D:\WORKSHOP\eCAADe-Tirana-DataScapes\eCAADe-Tirana-Data-Scapes-data-downloader\output\")
importshp = ImportShapefileFeatures(ShapefilePath=path, Reproject=True)  # -> Points, Metadata, UTMZone, TranslationVector
avr = Average(Input=importshp.Points)

utm = Data(importshp.UTMZone)
vec = Data(importshp.TranslationVector)

utm_2 = Data(importshp.UTMZone)
vec_2 = Data(importshp.TranslationVector)

cir = Circle(Plane=avr, Radius=1)
importshp_2 = ImportShapefileFeatures(ShapefilePath=path_2, Reproject=True, UTMZone=utm_2, TranslationVector=vec_2)  # -> Points, Metadata, UTMZone, TranslationVector
alongcrv = SortAlongCurve(Points=importshp.Points, Curve=cir)  # -> Points, Indices
pline = PolyLine(Vertices=alongcrv.Points, Closed=invert(False))
dir = DirectoryContents(FolderPath=raster_directory, Filter="*", IncludeSubfolders=invert(False))  # -> FilePaths, FileNames
nurbs = NurbsCurve(Vertices=importshp_2.Points, Degree=3, Periodic=Toggle(True))  # -> Curve, Length, Domain
tmatch = MatchText(Text=dir.FileNames, Pattern="GFC-forest-extent", Case=True)
cull = CullPattern(List=dir.FilePaths, CullPattern=tmatch)
boundary = BoundarySurfaces(Edges=pline)
pt = ConstructPoint(XCoordinate="0.5", YCoordinate="0.5", ZCoordinate=0)
path_3 = FilePath(cull)
evalsrf = EvaluateSurface(Surface=reparameterize(boundary), Point=pt)  # -> Point, Normal, UDirection, VDirection, Frame
meter = Slider(600, range=0..1000)
explode = Explode(Curve=pline, Recursive=True)  # -> Segments, Vertices
prot = RotatePlane(Plane=evalsrf.Frame, Angle=degrees("180"))
len = Length(Curve=explode.Segments)
bbox = BoundingBox(Content=pline, Plane=prot)  # -> Box, Box_2
division = Division(A=len, B=meter)
item = ListItem(List=division, Index=0, Wrap=True)  # -> Item, Item1
img = ImportImage(File=path_3, Rectangle=bbox.Box, XSamples=item.Item, YSamples=item.Item1)

demesh = DeconstructMesh(Mesh=img)  # -> Vertices, Faces, Colours, Normals
ahsv = SplitAHSV(Colour=demesh.Colours)  # -> Alpha, Hue, Saturation, Value
bool = Boolean(ahsv.Value)
cull_2 = CullPattern(List=demesh.Vertices, CullPattern=bool)
disc = Discontinuity(Curve=pline, Level=1)  # -> Points, Parameters
qt = QuadTree(Points=flatten([cull_2, disc.Points]), Plane=pline, Square=invert(False), Group=Slider(10, range=0..10))  # -> Quads, Points
crv = Curve(qt.Quads)

demesh_2 = DeconstructMesh(Mesh=img)  # -> Vertices, Faces, Colours, Normals
# IDWB - basin
# bbox-tiles
# bbox-tiles
# bbox-tiles
number_slider = Slider(500, range=0..1000)
ahsv_2 = SplitAHSV(Colour=demesh_2.Colours)  # -> Alpha, Hue, Saturation, Value
bnd = Bounds(Numbers=ahsv_2.Value)
dom = ConstructDomain(DomainStart=Slider(100, range=0..100), DomainEnd=number_slider)
remap = RemapNumbers(Value=ahsv_2.Value, Source=bnd, Target=dom)  # -> Mapped, Clipped
bool_2 = Boolean(ahsv_2.Value)
cull_3 = CullPattern(List=demesh_2.Vertices, CullPattern=bool_2)
cull_4 = CullPattern(List=remap.Mapped, CullPattern=bool_2)
Y = UnitY(Factor=1)
Z = UnitZ(Factor=1)
vrot = Rotate(Vector=Y, Axis=Z, Angle=Slider(45, range=0..90))
line = LineSDL(Start=cull_3, Direction=vrot, Length=cull_4)

demesh_3 = DeconstructMesh(Mesh=img)  # -> Vertices, Faces, Colours, Normals
ahsv_3 = SplitAHSV(Colour=demesh_3.Colours)  # -> Alpha, Hue, Saturation, Value
bnd_2 = Bounds(Numbers=ahsv_3.Value)
dom_2 = ConstructDomain(DomainStart=Slider(10, range=0..100), DomainEnd=Slider(200, range=0..1000))
remap_2 = RemapNumbers(Value=ahsv_3.Value, Source=bnd_2, Target=dom_2)  # -> Mapped, Clipped
bool_3 = Boolean(ahsv_3.Value)
cull_5 = CullPattern(List=demesh_3.Vertices, CullPattern=bool_3)
cull_6 = CullPattern(List=remap_2.Mapped, CullPattern=bool_3)
cir_2 = Circle(Plane=cull_5, Radius=cull_6)

viz_quadtree = Data()
viz_dot = Data()
viz_line = Data()
bbox_tile = Data(pline)
entwine = Entwine(Branch00=bbox_tile, Branch01=viz_quadtree, Branch02=viz_dot, Branch03=viz_line, FlattenInputs=True)
