# Grasshopper definition 3_Export_PythonSDK.gh (Grasshopper 1.0.7)

p3 = Panel("494.04, -315.55, 81.84")
# Curve in Rhino plane coordinates
crv = Curve([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])
# Destination plane in robot coordinates
# ------------ with 4pt calibration ------------
pt1 = Panel("194.11, -15.55, 76.06")
pt2 = Panel("194.09, -315.55, 76.14")
p4 = Panel("494.06, -15.55, 80.76")
topoly = CurveToPolyline(Curve=crv, ToleranceDistance="0.5", ToleranceAngle=0, MinEdge="2", MaxEdge="2")  # -> Polyline, Segments
explode = Explode(Curve=topoly.Polyline, Recursive=True)  # -> Segments, flatten(Vertices)
merge = Merge(Data1=pt1, Data2=pt2, Data3=p3, Data4=p4)
# Import Libraries and Product print
panel = Panel("""# Original code: Vinman <vinman.wen@ufactory.cc> <vinman.cub@gmail.com>
# Edited by: Iacopo Neri <neri.iacopo@gmail.com> Eugenio Bettucchi <eugenio.bettuchi@gmail.com> Erze Dinarama <erzadinarama@gmail.com>

\"\"\"
# Notice
#   1. Changes to this file on Studio will not be preserved
#   2. The next conversion will overwrite the file with the same name
\"\"\"
import sys
import math
import time
import datetime
import random
import traceback
import threading

\"\"\"
# xArm-Python-SDK: https://github.com/xArm-Developer/xArm-Python-SDK
# git clone git@github.com:xArm-Developer/xArm-Python-SDK.git
# cd xArm-Python-SDK
# python setup.py install
\"\"\"
try:
    from xarm.tools import utils
except:
    pass
from xarm import version
from xarm.wrapper import XArmAPI

def pprint(*args, **kwargs):
    try:
        stack_tuple = traceback.extract_stack(limit=2)[0]
        print('[{}][{}] {}'.format(time.strftime('%Y-%m-%d %H:%M:%S', time.localtime(time.time())), stack_tuple[1], ' '.join(map(str, args))))
    except:
        print(*args, **kwargs)

pprint('xArm-Python-SDK Version:{}'.format(version.__version__))

arm = XArmAPI('192.168.1.220')
arm.clean_warn()
arm.clean_error()
arm.motion_enable(True)
arm.set_mode(0)
arm.set_state(0)
time.sleep(1)""")
pt = Point(merge)
plfit = PlaneFit(Points=pt)  # -> Plane, Deviation
rotate = Rotate(Geometry=plfit.Plane, Angle=degrees("-90"), Plane=plfit.Plane)  # -> Geometry, Transform
xy = XYPlane(Origin=Point(0, 0, 0))
orient = Orient(Geometry=explode.Vertices, Source=xy, Target=rotate.Geometry)  # -> Geometry, Transform
# Errors handling
panel_2 = Panel("""# Register error/warn changed callback
def error_warn_change_callback(data):
    if data and data['error_code'] != 0:
        params['quit'] = True
        pprint('err={}, quit'.format(data['error_code']))
        arm.release_error_warn_changed_callback(error_warn_change_callback)
arm.register_error_warn_changed_callback(error_warn_change_callback)


# Register state changed callback
def state_changed_callback(data):
    if data and data['state'] == 4:
        if arm.version_number[0] > 1 or (arm.version_number[0] == 1 and arm.version_number[1] > 1):
            params['quit'] = True
            pprint('state=4, quit')
            arm.release_state_changed_callback(state_changed_callback)
arm.register_state_changed_callback(state_changed_callback)


# Register counter value changed callback
if hasattr(arm, 'register_count_changed_callback'):
    def count_changed_callback(data):
        if not params['quit']:
            pprint('counter val: {}'.format(data['count']))
    arm.register_count_changed_callback(count_changed_callback)


# Register connect changed callback
def connect_changed_callback(data):
    if data and not data['connected']:
        params['quit'] = True
        pprint('disconnect, connected={}, reported={}, quit'.format(data['connected'], data['reported']))
        arm.release_connect_changed_callback(error_warn_change_callback)
arm.register_connect_changed_callback(connect_changed_callback)""")
# Move line (arc)
number_slider = Slider(2, range=0..10)
long = LongestList(ListA=orient.Geometry, ListB="180", ListC="0", ListD="0", ListE="-1", PaddingMode=2)  # -> ListA, ListB, ListC, ListD, ListE
pdecon = Deconstruct(Point=orient.Geometry)  # -> XComponent, YComponent, ZComponent
panel_3 = Panel("""# Reset Position 0,0,0
if arm.error_code == 0 and not params['quit']:
    arm.reset()""")
expression = Expression(x=pdecon.XComponent, y=number_slider, Expression="round(x,y)")
expression_2 = Expression(x=pdecon.YComponent, y=number_slider, Expression="round(x,y)")
expression_3 = Expression(x=pdecon.ZComponent, y=number_slider, Expression="round(x,y)")
panel_4 = Panel("""    if code != 0:
        params['quit'] = True
        pprint('set_position, code={}'.format(code))""")
python = GhPythonScript(Speed="100", Acc="2000", Angle_Speed="20", Angle_Acc="500")  # -> out, a
# ---------- python: Python ----------
__author__ = "iacopo"
__version__ = "2021.10.03"

import rhinoscriptsyntax as rs

a = "params = {'speed': " + Speed + ", 'acc': " + Acc + ", 'angle_speed': " + Angle_Speed + ", 'angle_acc': " + Angle_Acc + ", 'events': {}, 'variables': variables, 'callback_in_thread': True, 'quit': False}"
# ---------- end python ----------
python_2 = GhPythonScript(X=expression, Y=expression_2, Z=expression_3, Roll=long.ListB, Pitch=long.ListC, Yaw=long.ListD, Radius=long.ListE)  # -> out, a
# ---------- python_2: Python ----------
__author__ = "iacopo"
__version__ = "2021.10.03"

import rhinoscriptsyntax as rs

a = "    code = arm.set_position(*[" + X + "," + Y + "," + Z + "," + Roll + "," + Pitch + "," + Yaw +"], speed=params['speed'], mvacc=params['acc'], radius=" + Radius + ", wait=False)"
# ---------- end python_2 ----------
concat = Concatenate(FragmentA="variables = {}", FragmentB=python.a)
concat_2 = Concatenate(FragmentA="if arm.error_code == 0 and not params['quit']:", FragmentB=python_2.a, FragmentC=panel_4)
# Release end
panel_5 = Panel("""# release all event
if hasattr(arm, 'release_count_changed_callback'):
    arm.release_count_changed_callback(count_changed_callback)
arm.release_error_warn_changed_callback(state_changed_callback)
arm.release_state_changed_callback(state_changed_callback)
arm.release_connect_changed_callback(error_warn_change_callback)""")
merge_2 = Merge(Data1=flatten(panel_3), Data2=flatten(concat_2))
join = TextJoin(Text=merge_2)
concat_3 = Concatenate(FragmentA=panel, FragmentB=concat, FragmentC=panel_2, FragmentD=join, FragmentE=panel_5)
f_str2file = SaveStringToFile(S=concat_3, file="test-crv.py", save=Button())  # -> info; inputs S: list of String, dir: String, file: String, save: Boolean
# ---------- f_str2file: C# ----------
                           /*
    froGH - a sparse collection of (in)utilities for Grasshopper

    Save string to file

    code by Alessio Erioli

    froGH by Co-de-iT is licensed under a Creative Commons Attribution 4.0 International License.
    http://creativecommons.org/licenses/by/4.0/

    */

    initComp();



    if (save){
      if (!Directory.Exists(dir)) Directory.CreateDirectory(dir);

      String target = dir + file;

      System.IO.File.WriteAllLines(target, S.ToArray());
      info = "file saved as: " + target;
    } else {
      info = "press save button to save file";
    }
# ---------- f_str2file: C# additional code ----------
  void initComp(){
    Component.Name = "Save String to File";
    Component.NickName = "f_Str2File";
    Component.Description = "Saves a text sequence to a file";

    Component.Params.Input[0].Name = "String";
    Component.Params.Input[0].Description = "string to save (as List)";
    Component.Params.Input[1].Name = "directory";
    Component.Params.Input[1].Description = "directory where the string file is saved";
    Component.Params.Input[2].Name = "fileName";
    Component.Params.Input[2].Description = "file name and extension (ex: myText.txt)";
    Component.Params.Input[3].Name = "save";
    Component.Params.Input[3].Description = "activate saving - attach a button and click to save";
    Component.Params.Output[0].Name = "info";
    Component.Params.Output[0].Description = "information on the saving process";
  }
# ---------- end f_str2file ----------
panel_6 = Panel(f_str2file)
